# Grasshopper definition debug.gh (Grasshopper 0.9.76)
# plug-ins: Radical

number_slider = Slider(0.164, range=0..1)
number_slider_2 = Slider(0.37, range=0..1)
number_slider_3 = Slider(0.37, range=0..1)
dgeg = Slider(0.883, range=0..1)
number_slider_4 = Slider(0.465, range=0..1)
graph = GraphMapper(
    dgeg,
    x0=0,
    x1=1,
    y0=0,
    y1=1,
    container_name="Sinc",
    Equation_X0=0.4273509085,
    Equation_X1=0.7434785366,
    Equation_Y0=0.9422633648,
    Equation_Y1=0.7391304374)
graph_2 = GraphMapper(
    number_slider_2,
    x0=0,
    x1=1,
    y0=0,
    y1=1,
    container_name="Sinc",
    Equation_X0=0.1579711437,
    Equation_X1=0.7434785366,
    Equation_Y0=0.3072463274,
    Equation_Y1=0.7391304374)
graph_3 = GraphMapper(
    number_slider,
    x0=0,
    x1=1,
    y0=0,
    y1=1,
    container_name="Sinc",
    Equation_X0=0.5805619955,
    Equation_X1=0.7434785366,
    Equation_Y0=0.7237856388,
    Equation_Y1=0.7391304374)
graph_4 = GraphMapper(
    number_slider_4,
    x0=0,
    x1=1,
    y0=0,
    y1=1,
    container_name="Sinc",
    Equation_X0=0.2681159377,
    Equation_X1=0.7434785366,
    Equation_Y0=0.4202898741,
    Equation_Y1=0.7391304374)
mm = MassMultiplication(Input=[graph_2, graph_3, graph_4, graph])  # -> Result, PartialResults
srf = Surface(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)
galapagos = Galapagos(gene=[number_slider_4, dgeg, number_slider, number_slider_2])
rad = Radical(Objective=mm.Result, NumericalVariables=[dgeg, number_slider_4, number_slider, number_slider_2])
